vi "Lab5Rx_Updated.gvi"   [LabVIEW Communications System Design Software 2.0.1]
panel controls:
  "IQ rate": f64 = 200000
  "carrier frequency": f64 = 915000000
  "gain (dB)": f64
  "active antenna": string = "RX2"
  "number of samples": i64 = 200000
  "stop": bool
  "niUSRP Device": "niUSRPClass"
panel indicators:
  "actual IQ rate": f64
  "actual carrier frequency": f64
  "actual gain (dB)": f64
  "error out": error
  "Demodulated Output": waveform<f64>[]
  "Phase Error": f64[]
uses:
  NI::Analysis::Filtering::Median Filter.gvi
  NI::Analysis::Conditioning::Unwrap Phase.gvi
diagram:
  call "niUSRP Open Rx Session.gvi"(niUSRP Device=$"niUSRP Device") -> (error out=w1, session handle out=w2)
  call "niUSRP Configure Signal.gvi"(session handle=w2, IQ rate=$"IQ rate", carrier frequency=$"carrier frequency", gain=$"gain (dB)", error in (no error)=w1, active antenna=$"active antenna") -> (session handle out=w3, coerced IQ rate=w4, coerced carrier frequency=w5, coerced gain=w6, Error Out=w7)
  call "niUSRP Initiate.gvi"(session handle=w3, error in (no error)=w7) -> (session handle out=w8, Error Out=w9)
  while {
    call "niUSRP Fetch Rx Data (CDB WDT).gvi"(session handle=w8, number of samples=$"number of samples", error in (no error)=w9) -> (session handle out=w10, data=w11, Error Out=w12)
    Logical Or(w12, $stop) -> w13
    Property Node(instance in=w11) -> ("Y"=w14, "dt"=w15, "Y"=w16)
    Square(x=w16) -> w17
    Complex To Polar(r * e^(i*theta)=w17) -> (theta=w18)
    call "Median Filter.gvi"(signal=w18) -> (filtered signal=w19)
    call "Unwrap Phase.gvi"(input phase=w19) -> (unwrapped phase=w20, error out=w21)
    Divide(x=w20, y=2) -> w22
    Polar To Complex(r=1, theta=w22) -> (r * e^(i*theta)=w23)
    Complex Conjugate(x + iy=w23) -> w24
    Multiply(w14, w24) -> w25
    Complex To Real Imaginary(x + iy=w25) -> (x=w26)
    Build Waveform Node(Y=w26, dt=w15) -> (output waveform=w27)
    Complex To Real Imaginary(x + iy=w16) -> (x=w28)
    Build Waveform Node(Y=w28, dt=w15) -> (output waveform=w29)
    Build Array(w27, w29) -> w30
    $"Demodulated Output" <- w30
    $"Phase Error" <- w22
    Property Node(instance in=w21)
    stop if w13
  }
  call "niUSRP Abort.gvi"(Handle in=w10, error in (no error)=w12) -> (Handle out=w31, Error Out=w32)
  call "niUSRP Close Session.gvi"(handle in=w31, error in=w32) -> (error out=w33)
  call "Simple Error Handler.gvi"(error in=w33) -> (error out=w34)
  $"error out" <- w34
  $"actual IQ rate" <- w4
  $"actual carrier frequency" <- w5
  $"actual gain (dB)" <- w6
